# Grasshopper definition recursive.gh (Grasshopper 1.0.4)
# plug-ins: FirstComponentTest

number_slider = Slider(2, range=0..10)
plane_surface = PlaneSurface(Plane=PlaneXY(0, 0, 0), XSize=Domain(-10, 10), YSize=Domain(-10, 10))
mesh_sphere_ex = MeshSphereEx(Base=PlaneXY(0, 0, 0), Radius=10, Count=5)
mesh_surface = MeshSurface(Surface=plane_surface, UCount=number_slider, VCount=number_slider, Overhang=True, Equalize=False)
mesh_faces_aggregation = MeshFacesAggregation(Mesh=mesh_surface, Displacement=Slider(0.25, range=0..1))
