# Grasshopper definition ripple.gh (Grasshopper 1.0.4)
# plug-ins: FirstComponentTest, Weaverbird

# ---- group: Sphere&Axis
Z = UnitZ(Factor=1)
xy = XYPlane(Origin=Point(0, 0, 0))
line = LineSDL(Start=xy, Direction=Z, Length=Slider(5, range=0..100))
msphereex = MeshSphereEx(Base=PlaneXY(0, 0, 0), Radius=10, Count=Slider(5, range=0..100))

# ----
sph = Sphere(Base=PlaneXY(0, 0, 0), Radius=1)
tapperfactor = Panel("1")

# ---- group: ScaleTaper(EggGenerate)
scale_nu = ScaleNU(Geometry=sph, Plane=PlaneXY(0, 0, 0), ScaleX=1, ScaleY=1, ScaleZ=Slider(1.5, range=0..10))  # -> Geometry, Transform
taper = Taper(
    Geometry=scale_nu.Geometry,
    Axis=line,
    Start=tapperfactor,
    End=Slider(0.2, range=0..10),
    Flat=False,
    Infinite=True,
    Rigid=False)

# ---- group: Get Z and Move
bbox = BoundingBox(Content=taper, Plane=PlaneXY(0, 0, 0))  # -> Box, Box_2
debox = DeconstructBox(Box=bbox.Box)  # -> Plane, X, Y, Z
num = Number(debox.Z)
Z_2 = UnitZ(Factor=num)  # -> expr("x/2", UnitVector)
move = Move(Geometry=taper, Motion=Z_2)  # -> Geometry, Transform

# ----
number_slider = Slider(5, range=0..5)
number_slider_2 = Slider(1, range=0..10)
pop3d = Populate3D(Region=move.Geometry, Count=move.Geometry, Seed=Slider(33, range=0..100))
wbpyramid = WeaverbirdsMeshPyramid(Plane=PlaneXY(0, 0, 0), Width=5, NumberOfSides=6, TopPoint=Point(0, 0, 10), BasePolygonMethod=True, FillStrategy=1)
meshrip = MeshRipple(Mesh=move.Geometry, AttractorPoints=pop3d, DispDistance=Slider(0.1, range=0..3), Iterations=Slider(1, range=0..100))  # -> Mesh, DispValues, P, unitize(V)
facen = FaceNormals(Mesh=move.Geometry)  # -> Centers, Normals
multiplication = Multiplication(A=meshrip.V, B=Slider(1, range=0..1))
vdis = VectorDisplay(Anchor=facen.Centers, Vector=multiplication)
mesh = Mesh(meshrip.Mesh)
preview = CustomPreview(
    Geometry=mesh,
    Material={diffuse=RGB(105, 105, 105), emission=RGB(0, 0, 0), shine=1, specular=RGB(255, 255, 255), transparency=0})
